# Grasshopper definition BirdFlocking_GH_Simon.gh (Grasshopper 1.0.7)

panel = Panel("C:\Users\simon\Dropbox\ITECH 2018-2019\ComputationalDesign\Assignments\FinalAssignment\CompDesing_Birdflocking\BirdFlocking\BirdFlocking.py")
timer = Timer(TimerInterval=20, Target=python)  # disabled
file = ReadFile(File=panel, PerLineParse=False)
pt = Point(Point(73.68979839, 1.050151986, -11.33960548))
python = GhPythonScript(
    Code=file,
    IReset=Button(),
    IEnabled=Toggle(False),
    IAgentCount=Slider(56, range=0..100),
    IFoodStrength=Slider(3.55, range=0..10),
    IFoodSource=pt)  # -> Out, OGeometry, OPositions
crv = Curve(python.OGeometry)
pt_2 = Point(python.OPositions)
